# Grasshopper definition sun_paths_initial.gh (Grasshopper 1.0.7)
# plug-ins: Pufferfish

width_1 = Slider(9, range=0..10)
width_streets = Slider(12, range=0..100)
street_1_a = Slider(2, range=2..8)
street_1_b = Slider(2, range=2..8)
street_2_a = Slider(8, range=1..9)
street_2_b = Slider(2, range=2..8)
radius = GetNumber(street_1_a, AtLeast=1, AtMost=1, Maximum=1.797693135e+308, Minimum=-1.797693135e+308, TreeAccess=False)
count = GetNumber(street_2_a, AtLeast=1, AtMost=1, Maximum=1.797693135e+308, Minimum=-1.797693135e+308, TreeAccess=False)
radius2 = GetNumber(street_1_b, AtLeast=1, AtMost=1, Maximum=1.797693135e+308, Minimum=-1.797693135e+308, TreeAccess=False)
count2 = GetNumber(street_2_b, AtLeast=1, AtMost=1, Maximum=1.797693135e+308, Minimum=-1.797693135e+308, TreeAccess=False)
merge = Merge(Data1=radius, Data2=radius2)
merge_2 = Merge(Data1=count, Data2=count2)

curve = Curve(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)
explode = Explode(Curve=curve, Recursive=True)  # -> Segments, Vertices
len = Length(Curve=explode.Segments)
panel = Panel("""0
1""")
sort = SortList(Keys=len, ValuesA=explode.Segments)  # -> Keys, ValuesA
cull_i = CullIndex(List=sort.ValuesA, Indices=panel, Wrap=True)
join = JoinCurves(Curves=cull_i, Preserve=False)

entwine = Entwine(Branch00=merge, Branch01=merge_2, FlattenInputs=True)
multiplication = Multiplication(A=entwine, B=0.1)
division = Division(A=width_streets, B=2)
addition = Addition(A=width_1, B=division)
neg = Negative(Value=addition)
ext = ExtendCurve(Curve=join, Type=0, Start=neg, End=neg)
graft = GraftTree(Tree=ext, IncludeEmptyLists=True, IncludeNullItems=True)
eval = EvaluateCurve(Curve=reparameterize(graft), Parameter=multiplication)  # -> Point, Tangent, Angle
flip = FlipMatrix(Data=eval.Point)
pline = PolyLine(Vertices=flip, Closed=False)
number_slider = Slider(20, range=0..100)
ext_2 = ExtendCurve(Curve=pline, Type=0, Start=number_slider, End=number_slider)
division_2 = Division(A=width_streets, B="2")
neg_2 = Negative(Value=division_2)
offcrv = OffsetCurve(Curve=ext_2, Plane=PlaneXY(0, 0, 0), Distance=division_2, BothSides=neg_2, Kinks=0, CapType=1)
rdiff = RegionDifference(CurvesA=curve, CurvesB=flatten(offcrv))
area = Area(Geometry=rdiff)  # -> Area, Centroid
larger = LargerThan(FirstNumber=area.Area, SecondNumber=Slider(500, range=0..1000))  # -> LargerThan, OrEqualTo
cull = CullPattern(List=rdiff, CullPattern=larger.LargerThan)
list_length = ListLength(List=cull)
random = Random(Range="5 to 25", Number=list_length, Seed=2)
unit_z = UnitZ(Factor=random)
extrude = Extrude(Base=cull, Direction=unit_z)
curve_2 = Curve(ext_2)
curve_3 = Curve(offcrv)
cap_holes = CapHoles(Brep=extrude)
merge_3 = Merge(Data1=curve_2, Data2=curve_3)  # -> flatten(Result)
mesh = Mesh(cap_holes)
curve_4 = Curve(merge_3)
context_bake = ContextBake(Geometry=mesh)
context_bake_2 = ContextBake(Geometry=curve_4)
